# Grasshopper definition test.gh (Grasshopper 1.0.4)
# plug-ins: GHMQTT Info

timer = Timer(TimerInterval=50, Target=mqtt)
mqtt = MQTT(BrokerURI="mqtt://localhost:1884/value")  # -> Value, Payload
panel = Panel(mqtt.Value)
split = TextSplit(Text=mqtt.Payload, Separators=",")
panel_2 = Panel(split)
num = Number(panel_2)
panel_3 = Panel(num)
